# Grasshopper definition TestDefinition.gh (Grasshopper 1.0.7)
# plug-ins: Component Parameter

pd = CreateIOParameter(
    Name="Test Input Curve",
    Nickname="TI",
    Description="An input curve param.",
    Usage="Input",
    DataAccess="Item",
    ParamType="Curve")
pd_2 = CreateIOParameter(
    Name="Test Input Curve",
    Nickname="TI",
    Description="An input plane param.",
    Usage="Input",
    DataAccess="Item",
    ParamType="Plane")
cd = CreateComponentData(
    Name="Another Test Component",
    Nickname="ATC",
    Description="Another test component.",
    Category="Component Configurator",
    SubCategory="Test",
    Exposure="Test")
cd_2 = CreateComponentData(
    Name="Test Component",
    Nickname="TC",
    Description="A test component.",
    Category="Component Configurator",
    SubCategory="Test",
    Exposure="Test")
pd_3 = CreateIOParameter(
    Name="Test Input Point",
    Nickname="TI",
    Description="An input point param.",
    Usage="Input",
    DataAccess="Item",
    ParamType="Point")
pd_4 = CreateIOParameter(
    Name="Test Output Number",
    Nickname="TO",
    Description="An output number param.",
    Usage="Output",
    DataAccess="Item",
    ParamType="Number")
merge = Merge(Data1=pd_3, Data2=pd_4)
merge_2 = Merge(Data1=pd, Data2=pd_2)
cc = CreateComponentDefinition(ComponentData=cd, ParameterData=merge_2)
cc_2 = CreateComponentDefinition(ComponentData=cd_2, ParameterData=merge)
path = FilePath("C:\Users\g.maciocci\source\repos\GrasshopperComponentConfigurator\TestDefinition\TestOutputDir\")
gc = GenerateComponentCode(OutputDirectory=path, ComponentDefinition=[cc, cc_2], Generate=Button())
